# Dynamo graph script.dyn "generic_model_genrate" (Dynamo 2.16.2.5624)
# packages: spring nodes 210.1.1, Data-Shapes 2024.2.113

# group: UI > Elements
code_block = CodeBlock { "Select model elements"; }
code_block_2 = CodeBlock { "Select Elements"; "Select"; false; }
selectmodelelements_data = Custom[SelectModelElements Data](InputName=code_block_2.out0, ButtonText=code_block_2.out1, SelectSingleElement=code_block_2.out2)  # package Data-Shapes; Creates a Revit element selection input for UI.MultipleInputForm++ . Check out www.data-shapes.net for more infos!
list_create = List.Create(item0=selectmodelelements_data)
inputgroup_data = Custom[InputGroup Data](GroupTitle=code_block, Inputs=list_create)  # package Data-Shapes; Creates a group of inputs for UI.MultipleInputForm ++ . Check out www.data-shapes.net for more infos !

# group: UI > Material
code_block_3 = CodeBlock { "Material name - (Do not change unles you have to)"; }
code_block_4 = CodeBlock { "Material Name"; "Default"; false; }
textbox_data = Custom[TextBox Data](InputName=code_block_4.out0, DefaultText=code_block_4.out1, IsNumberEntry=code_block_4.out2)  # package Data-Shapes; Create Data for TextBox input in UI.MultipleInputForm ++ . Check out www.data-shapes.net for more informations
list_create_2 = List.Create(item0=textbox_data)
inputgroup_data_2 = Custom[InputGroup Data](GroupTitle=code_block_3, Inputs=list_create_2)

# group: UI > Path
code_block_5 = CodeBlock { "Select Path of Generic model family template"; }
code_block_6 = CodeBlock { "Select path"; }
file_path = Filename("..\..\..\ProgramData\Autodesk\RVT 2023\Family Templates\English\Metric Generic Model.rft")  # graph input
code_block_7 = CodeBlock { "Metric Generic Model.rfa"; }
filepath_data = Custom[FilePath Data](InputName=code_block_6, DefaulPath=file_path, ButtonText=code_block_7)  # package Data-Shapes; Create filepath input for UI.MultipleInputForm ++ . Check out www.data-shapes.net for more infos !
list_create_3 = List.Create(item0=filepath_data)
inputgroup_data_3 = Custom[InputGroup Data](GroupTitle=code_block_5, Inputs=list_create_3)

# group: UI
code_block_8 = CodeBlock { "Create generic models"; "Create"; "Cancel"; }
list_create_4 = List.Create(item0=inputgroup_data, item1=inputgroup_data_2, item2=inputgroup_data_3)
boolean = BoolSelector(true)
code_block_9 = CodeBlock { 1200; 800; 350; }
multipleinputform = Custom[MultipleInputForm ++](Description_optional=code_block_8.out0, ButtonText_optional=code_block_8.out1, Inputs=list_create_4, Toggle=boolean, CancelButtonText_optional=code_block_8.out2, MaxHeight_optional=code_block_9.out0, Width_optional=code_block_9.out1, LabelWidth_optional=code_block_9.out2)  # package Data-Shapes; Create a form with multiple inputs. see www.data-shapes.net for tutorials and infos!
code_block_10 = CodeBlock(select_elements=multipleinputform.User_Inputs, material=multipleinputform.User_Inputs, seelct_path=multipleinputform.User_Inputs) { select_elements [0]; material [1]; seelct_path [2]; }

# group: SCRIPT
python_script = Python(IN[0]=code_block_10.out0)  # IronPython2
# ---------- python_script.python (79 lines) ----------
import clr
import System
import sys
clr.AddReference('ProtoGeometry')
from Autodesk.DesignScript.Geometry import *
import Autodesk.DesignScript.Geometry as DS


clr.AddReference('RevitAPI')
from Autodesk.Revit.DB import *

clr.AddReference("RevitNodes")
import Revit
clr.ImportExtensions(Revit.Elements)
clr.ImportExtensions(Revit.GeometryConversion)

clr.AddReference("RevitServices")
import RevitServices
from RevitServices.Persistence import DocumentManager
from RevitServices.Transactions import TransactionManager

	
def get_AllSolid(lst_elem, inc = 0):
	# sub functon
	def populate_lstGeo(g):
		if isinstance(g, Solid) and g.Volume > 0: 
			solids.append(g)
		elif isinstance(g, GeometryInstance):
			geoInst.append(g)
		else:pass
	#
	# main 	functon		
	global opt
	solids = []
	geoInst = []
	lst_elem = lst_elem if hasattr(lst_elem, "__iter__") else [lst_elem]
	if len(lst_elem) > 0 and inc < 2000:
		for elem in lst_elem:
			if isinstance(elem, GeometryInstance):
				for j in elem.GetInstanceGeometry():
					populate_lstGeo(j)
			else:
				geoSet = elem.get_Geometry(opt)
				for i in geoSet:
					populate_lstGeo(i)
		return solids + get_AllSolid(geoInst, inc + 1)
	else:
		return []
		

elem = UnwrapElement(IN[0])

opt = Options()
solids = get_AllSolid(elem)

ds_Solids = []
for s in solids:
	try:
		ds_Solid = s.ToProtoType()
		ds_Solids.append(ds_Solid)
	except Exception as ex:
		if "trim_with_edge_loops" in str(ex):
			# failed conversion DB.Solid to Prototype -> try get make solid with ByJoinedSurfaces 
			ds_face = []
			for f in s.Faces:
				try:
					ds_face.extend(f.ToProtoType())
				except:
					# failed conversion DB.Face to Prototype -> try get make Surface with PolyCurves.Patch 
					ds_edges = [c.ToProtoType() for curveloop in f.GetEdgesAsCurveLoops() for c in  curveloop]
					ds_poly_edges = PolyCurve.ByJoinedCurves(ds_edges)
					ds_face.append(ds_poly_edges.Patch())
			ds_Solid = DS.Solid.ByJoinedSurfaces(ds_face)
			ds_Solids.append(ds_Solid)
		else:
			raise Exception(ex)
		

OUT = ds_Solids
# ----------------------------------------
list_create_5 = List.Create(item0=python_script)
flatten = List.Flatten(list=list_create_5)
count = List.Count(list=flatten)
randomList = Math.RandomList(amount=count)
code_block_11 = CodeBlock { 8; }
round = Math.Round(number=randomList, digits=code_block_11)
ꟿ_number_tostring = Custom[ꟿ Number.ToString](num=round)  # package spring nodes; Converts the input number(s) to string. You can optionally limit the number of digits.

# group: Output
categories = Categories("OST_GenericModel")
ꟿ_familyinstance_bygeometry = Custom[ꟿ FamilyInstance.ByGeometry](geometry=flatten, familyTemplatePath=code_block_10.out2, familyName=ꟿ_number_tostring, category=categories, materialName=code_block_10.out1)  # package spring nodes; You must provide a valid family template path that will be used for all input geometry objects. The project units(and not the templates) will be used to determine the size of the output geometry. The provided category will be used only if the family template supports it. If not, the default template category will be used instead. Likewise, the family material(provided as a string) will be set only if a material with that name exists in the template. If not, the default material will be used instead ("By Category"). For void cuts, the material settings will be ignored. The Subcategory name is an optional input. If you'd like to skip assigning a Subcategory to any new instance, simply use null. The node expects a unique family name for each geometry object. The rest of the input lists will be processed as if the node lacing is set to longest.
